% Simulink data dictionary data_interface.sldd

SetPoint = Simulink.Bus()
  reference: double, Unit="deg"

Control_Command = Simulink.Bus()
  voltage: double, Min=-100, Max=100, Unit="%"

Driver_Feedback = Simulink.Bus()
  current: double, Unit="A"
  power: double, Unit="W"

Vcc = 24
max_position_error = Simulink.Parameter(1, DataType="double", Unit="deg")
max_settling_time = Simulink.Parameter(1, DataType="double", Unit="s")
max_settling_velocity = Simulink.Parameter(2, DataType="double", Unit="deg/s")
max_power = Simulink.Parameter(120, DataType="double", Unit="W")

Joint_Feedback = Simulink.Bus()
  encoder: double, Unit="deg"
  velocity: double, Unit="deg/s"
  torque: double, Unit="N*m"

Ts = Simulink.Parameter(0.001, DataType="double", Min=0, Max=1, Unit="s")  % Sample time.
pendulum_1_length = Simulink.Parameter(0.2, DataType="double", Min=0, Unit="m")
pendulum_mass = Simulink.Parameter(0.1, DataType="double", Min=0, Unit="kg")
pendulum_2_length = Simulink.Parameter(0.3, DataType="double", Min=0, Unit="m")

Obstacle_Case_Feedback = Simulink.Bus()
  corrected_set_point: double, Unit="deg"
  obstacle_detected: double